# Grasshopper definition RefilterByName.gh (Grasshopper 1.0.7)
# plug-ins: Speckle 2, LunchBox, eleFront, Human

pipeline = GeometryPipeline(
    GroupByLayer=False,
    GroupByType=False,
    IncludeHidden=True,
    IncludeLocked=True,
    LayerFilter="*",
    NameFilter="*",
    SublayerFiltering=True,
    TypeFilter=32)
lng = ListLength(List=pipeline)
dam = DataDam(DataA=pipeline, BufferDelay=10000000, BufferMode=0)
input = DataInput(UpdateDelay=50000)
data = Data()
objdet = ObjectDetails(Object=dam)  # -> Referenced, Available, Name, Layer, Colour, Guid
split = TextSplit(Text=objdet.Name, Separators="[")
item = ListItem(List=split, Index=0, Wrap=True)
pshift = ShiftPaths(Data=item, Offset=-1)
tmatch = MatchText(Text=pshift, Pattern="*M_Single*", Case=True)
tmatch_2 = MatchText(Text=pshift, Pattern="*Railing*", Case=True)
tmatch_3 = MatchText(Text=pshift, Pattern="*Wood*", Case=True)
cset = CreateSet(List=pshift)  # -> Set, Map
tmatch_4 = MatchText(Text=pshift, Pattern="*Basic Wall*", Case=True)
tmatch_5 = MatchText(Text=pshift, Pattern="*Curtain*", Case=True)
tmatch_6 = MatchText(Text=pshift, Pattern="*Beam*", Case=True)
dispatch = Dispatch(List=pshift, DispatchPattern=tmatch)  # -> ListA, ListB
dispatch_2 = Dispatch(List=pshift, DispatchPattern=tmatch_2)  # -> ListA, ListB
tmatch_7 = MatchText(Text=pshift, Pattern="*Lamp*", Case=True)
dispatch_3 = Dispatch(List=pshift, DispatchPattern=tmatch_3)  # -> ListA, ListB
tmatch_8 = MatchText(Text=pshift, Pattern="*Glazed*", Case=True)
tmatch_9 = MatchText(Text=pshift, Pattern="*Concrete*", Case=True)
dispatch_4 = Dispatch(List=pshift, DispatchPattern=tmatch_5)  # -> ListA, ListB
dispatch_5 = Dispatch(List=pshift, DispatchPattern=tmatch_6)  # -> ListA, ListB
cset_2 = CreateSet(List=dispatch_2.ListA)  # -> Set, Map
dispatch_6 = Dispatch(List=dam, DispatchPattern=tmatch)  # -> ListA, ListB
dispatch_7 = Dispatch(List=dam, DispatchPattern=tmatch_2)  # -> ListA, ListB
dispatch_8 = Dispatch(List=pshift, DispatchPattern=tmatch_7)  # -> ListA, ListB
cset_3 = CreateSet(List=dispatch.ListA)  # -> Set, Map
cset_4 = CreateSet(List=dispatch_3.ListA)  # -> Set, Map
dispatch_9 = Dispatch(List=dam, DispatchPattern=tmatch_3)  # -> ListA, ListB
panel = Panel(cset_2.Set)
dispatch_10 = Dispatch(List=pshift, DispatchPattern=tmatch_8)  # -> ListA, ListB
tmatch_10 = MatchText(Text=pshift, Pattern="*Mullion*", Case=True)
dispatch_11 = Dispatch(List=pshift, DispatchPattern=tmatch_4)  # -> ListA, ListB
dispatch_12 = Dispatch(List=pshift, DispatchPattern=tmatch_9)  # -> ListA, ListB
dispatch_13 = Dispatch(List=dam, DispatchPattern=tmatch_4)  # -> ListA, ListB
cset_5 = CreateSet(List=dispatch_11.ListA)  # -> Set, Map
dispatch_14 = Dispatch(List=dam, DispatchPattern=tmatch_5)  # -> ListA, ListB
cset_6 = CreateSet(List=dispatch_4.ListA)  # -> Set, Map
dispatch_15 = Dispatch(List=dam, DispatchPattern=tmatch_6)  # -> ListA, ListB
cset_7 = CreateSet(List=dispatch_5.ListA)  # -> Set, Map
cset_8 = CreateSet(List=dispatch_8.ListA)  # -> Set, Map
cset_9 = CreateSet(List=dispatch_10.ListA)  # -> Set, Map
list = Accounts(
    {"No account selected": , "Account (xavier.garnavault@gmail.com | https://app.speckle.systems)": "https://app.speckle.systems/?id=c5b3fb8413"}, selected="Account (xavier.garnavault@gmail.com | https://app.speckle.systems)",
    FirstSelectedItem="https://app.speckle.systems/?id=c5b3fb8413")
dispatch_16 = Dispatch(List=dam, DispatchPattern=tmatch_8)  # -> ListA, ListB
sift = SiftPattern(List=dispatch_7.ListA, SiftPattern=cset_2.Map)  # -> Output0, Output1, Output2, Output3, Output4, Output5
dispatch_17 = Dispatch(List=dam, DispatchPattern=tmatch_9)  # -> ListA, ListB
getkv = GetAllKeysValues(AttributesOrAttributedGeometry=dispatch_17.ListA)  # -> Keys, Values, BakeName
cset_10 = CreateSet(List=dispatch_12.ListA)  # -> Set, Map
dispatch_18 = Dispatch(List=dam, DispatchPattern=tmatch_7)  # -> ListA, ListB
sift_2 = SiftPattern(List=dispatch_6.ListA, SiftPattern=cset_3.Map)  # -> Output0, Output1, Output2, Output3, Output4, Output5
panel_2 = Panel(cset_4.Set)
item_2 = ListItem(List=cset_3.Set, Index=0, Wrap=True)  # -> Item, Item1, Item2, Item3, Item4
panel_3 = Panel(cset_3.Map)
sift_3 = SiftPattern(List=dispatch_9.ListA, SiftPattern=cset_4.Map)  # -> Output0, Output1, Output2, Output3, Output4, Output5
panel_4 = Panel(cset_5.Set)
dispatch_19 = Dispatch(List=pshift, DispatchPattern=tmatch_10)  # -> ListA, ListB
sift_4 = SiftPattern(List=dispatch_13.ListA, SiftPattern=cset_5.Map)  # -> Output0, Output1, Output2, Output3, Output4
getuv = GetUserValue(Geometry=dispatch_17.ListA)
sift_5 = SiftPattern(List=dispatch_14.ListA, SiftPattern=cset_6.Map)  # -> Output0, Output1, Output2, Output3, Output4, Output5
dispatch_20 = Dispatch(List=dam, DispatchPattern=tmatch_10)  # -> ListA, ListB
sift_6 = SiftPattern(List=dispatch_15.ListA, SiftPattern=cset_7.Map)  # -> Output0, Output1
sift_7 = SiftPattern(List=dispatch_17.ListA, SiftPattern=cset_10.Map)  # -> Output0, Output1, Output2, Output3, Output4, Output5
mesh = Mesh(sift.Output1)
mesh_2 = Mesh(sift_2.Output1)
sift_8 = SiftPattern(List=dispatch_16.ListA, SiftPattern=cset_9.Map)  # -> Output0, Output1, Output2
panel_5 = Panel("https://app.speckle.systems/projects/8902afff2a/models/2a3403247f")
sift_9 = SiftPattern(List=dispatch_18.ListA, SiftPattern=cset_8.Map)  # -> Output0, Output1
sort_val = SortDuplicateValues(ValueList=dispatch_12.ListA)  # -> UniqueValues, Indices
mesh_3 = Mesh(sift_3.Output1)
item_3 = ListItem(List=cset_2.Set, Index=0, Wrap=True)  # -> Item, Item1, Item2
panel_6 = Panel(cset_8.Set)
mesh_4 = Mesh(sift_4.Output1)
panel_7 = Panel("https://app.speckle.systems/projects/8902afff2a/models/4e3ff4a571")
cset_11 = CreateSet(List=dispatch_19.ListA)  # -> Set, Map
panel_8 = Panel(cset_7.Set)
mesh_5 = Mesh(sift_5.Output1)
panel_9 = Panel("https://app.speckle.systems/projects/8902afff2a/models/78980e118b")
python = GhPythonScript(x=getkv.Keys, y=getkv.Values)  # -> out, a
# ---------- python: Python ----------
__author__ = "Xavier"
__version__ = "2024.04.21"

import rhinoscriptsyntax as rs
a = dict()
a[x]=y
# ---------- end python ----------
mesh_6 = Mesh(sift_6.Output1)
item_4 = ListItem(List=cset_6.Set, Index=0, Wrap=True)  # -> Item, Item1
mesh_7 = Mesh(sift_8.Output0)
item_5 = ListItem(List=cset_5.Set, Index=0, Wrap=True)  # -> Item, Item1, Item2, Item3, Item4
sift_10 = SiftPattern(List=dispatch_20.ListA, SiftPattern=cset_11.Map)  # -> Output0, Output1, Output2
mesh_8 = Mesh(sift_7.Output1)
item_6 = ListItem(List=cset_11.Set, Index=0, Wrap=True)  # -> Item, Item1
panel_10 = Panel(item_6.Item)
lng_2 = ListLength(List=dispatch_19.ListA)
item_7 = ListItem(List=cset_7.Set, Index=0, Wrap=True)  # -> Item, Item1
pshift_2 = ShiftPaths(Data=python.a, Offset=-1)
item_8 = ListItem(List=dispatch_17.ListA, Index=sort_val.Indices, Wrap=True)
mesh_9 = Mesh(item_8)
concat = Concatenate(FragmentA="Lamp::", FragmentB=cset_8.Set)
clean = CleanTree(RemoveNulls=True, RemoveInvalid=True, RemoveEmpty=False, Tree=mesh_9)
mesh_10 = Mesh(dispatch_20.ListA)
clean_2 = CleanTree(RemoveNulls=True, RemoveInvalid=True, RemoveEmpty=False, Tree=mesh_8)
repeat = RepeatData(Data="Name", Length=lng_2)
panel_11 = Panel("https://app.speckle.systems/projects/8902afff2a/models/2a3403247f")
python_2 = GhPythonScript(x=pshift_2)  # -> out, a; inputs x: list
# ---------- python_2: Python ----------
__author__ = "Xavier"
__version__ = "2024.04.21"

import rhinoscriptsyntax as rs
a = [x]
# ---------- end python_2 ----------
item_9 = ListItem(List=concat, Index=0, Wrap=True)  # -> Item, Item1
mesh_11 = Mesh(sift_9.Output1)
volume = Volume(Geometry=clean)  # -> Volume, Centroid
clean_3 = CleanTree(RemoveNulls=True, RemoveInvalid=True, RemoveEmpty=False, Tree=mesh_10)
clean_4 = CleanTree(RemoveNulls=True, RemoveInvalid=True, RemoveEmpty=False, Tree=sift_10.Output0)
sort_val_2 = SortDuplicateValues(ValueList=dispatch_12.ListA)  # -> UniqueValues, Indices
lng_3 = ListLength(List=dispatch_8.ListA)
volume_2 = Volume(Geometry=clean_2)  # -> Volume, Centroid
clean_5 = CleanTree(RemoveNulls=True, RemoveInvalid=True, RemoveEmpty=False, Tree=sift_10.Output1)
division = Division(A=volume.Volume, B=1000000000)
cso = CreateSpeckleObject(A=dispatch_18.ListA, selectedKitName="Objects")
esokv = ExtendSpeckleObjectByKeyValue(SpeckleObject=clean_4, Keys="Name", Values=item_6.Item, selectedKitName="Objects")
division_2 = Division(A=volume_2.Volume, B=1000000000)
panel_12 = Panel(volume.Volume)
sget = StreamGet(StreamIDURL=panel_5, SpeckleAccount=list)
medges = MeshEdges(Mesh=clean_4)  # -> NakedEdges, InteriorEdges, NonManifoldEdges
repeat_2 = RepeatData(Data="Name", Length=lng_3)
item_10 = ListItem(List=dispatch_17.ListA, Index=sort_val_2.Indices, Wrap=True)
sget_2 = StreamGet(StreamIDURL=panel_9, SpeckleAccount=list)
sget_3 = StreamGet(StreamIDURL=panel_7, SpeckleAccount=list)
esokv_2 = ExtendSpeckleObjectByKeyValue(SpeckleObject=graft(clean), Keys="Volume (m³)", Values=graft(volume.Volume), selectedKitName="Objects")
merge = Merge(Data1=medges.NakedEdges, Data2=medges.InteriorEdges)
screate = CreateStream(SpeckleAccount=list, stream="f076490c51 https://app.speckle.systems c5b3fb8413")
unflatten = UnflattenTree(Tree=dispatch_12.ListA, Guide=esokv_2)
len = Length(Curve=merge)
esokv_3 = ExtendSpeckleObjectByKeyValue(SpeckleObject=graft(dispatch_18.ListA), Keys=graft(repeat_2), Values=graft(dispatch_8.ListA), selectedKitName="Objects")
pshift_3 = ShiftPaths(Data=esokv_3, Offset=-1)
esokv_4 = ExtendSpeckleObjectByKeyValue(SpeckleObject=esokv_2, Keys="Name", Values=unflatten, selectedKitName="Objects")
esokv_5 = ExtendSpeckleObjectByKeyValue(SpeckleObject=graft(clean_2), Keys="Volume (m³)", Values=graft(division_2), selectedKitName="Objects")
esokv_6 = ExtendSpeckleObjectByKeyValue(SpeckleObject=esokv_4, Keys="prices", Values=python_2.a, selectedKitName="Objects")
send = Send(
    Stream=screate,
    Data=clean_3,
    AutoSend=False,
    BaseId="967e1f97fb0b82cc433b068e0273432a",
    CurrentComponentState="expired",
    KitName="Objects",
    OutputWrappers="https://app.speckle.systems\tf076490c51\t560affe94c",
    UseDefaultCache=True,
    selectedKitName="Objects")
pshift_4 = ShiftPaths(Data=esokv_2, Offset=-1)
panel_13 = Panel(pshift_3)
esokv_7 = ExtendSpeckleObjectByKeyValue(SpeckleObject=clean_5, Keys="Name", Values=item_6.Item1, selectedKitName="Objects")
sget_4 = StreamGet(StreamIDURL=panel_11, SpeckleAccount=list)
send_2 = Send(
    Stream=sget_3,
    Lighting=pshift_3,
    AutoSend=False,
    BaseId="bd585d54e7920a79a26ab5959723c7df",
    CurrentComponentState="expired",
    KitName="Objects",
    OutputWrappers="https://app.speckle.systems\t8902afff2a\t679d73dee3",
    UseDefaultCache=True,
    selectedKitName="Objects")
pshift_5 = ShiftPaths(Data=esokv_4, Offset=-2)
send_3 = Send(
    Stream=sget,
    Concrete=pshift_5,
    AutoSend=False,
    BaseId="74fc3b79be67d4667a09f4e11edf1048",
    CurrentComponentState="expired",
    KitName="Objects",
    OutputWrappers="https://app.speckle.systems\t8902afff2a\t0d8d15fa05",
    UseDefaultCache=True,
    selectedKitName="Objects")
sort = SortList(Keys=len, ValuesA=merge)  # -> Keys, ValuesA
cset_12 = CreateSet(List=sort.Keys)  # -> Set, Map
item_11 = ListItem(List=cset_12.Set, Index=0, Wrap=True)  # -> Item, Item1, Item2, Item3, Item4
int = Integer(item_11.Item3)
pshift_6 = ShiftPaths(Data=int, Offset=-1)
int_2 = Integer(item_11.Item)
int_3 = Integer(item_11.Item1)
send_4 = Send(
    Stream=sget_4,
    Concrete=pshift_5,
    AutoSend=False,
    BaseId="74fc3b79be67d4667a09f4e11edf1048",
    CurrentComponentState="up_to_date",
    KitName="Objects",
    OutputWrappers="https://app.speckle.systems\t8902afff2a\t360ecb357a",
    UseDefaultCache=True,
    selectedKitName="Objects")
receive = Receive(
    Stream=sget_4,
    AutoReceive=True,
    CurrentComponentState="expired",
    ExpandOutput=True,
    LastInfoMessage="Sylvain van der Meer @ 04/21/2024 08:54:18: Update from viktor app (id:66845be03a)",
    ReceiveOnOpen=False,
    ReceivedCommitId="66845be03a",
    StreamWrapper="https://app.speckle.systems/projects/8902afff2a/models/2a3403247f?u=c5b3fb8413",
    selectedKitName="None")  # -> Info, Concrete, Units
concat_2 = Concatenate(FragmentA=int_2, FragmentC="x", FragmentB=int_3)
pshift_7 = ShiftPaths(Data=concat_2, Offset=-1)
esokv_8 = ExtendSpeckleObjectByKeyValue(SpeckleObject=graft(esokv), Keys="Section", Values=graft(pshift_7), selectedKitName="Objects")
esokv_9 = ExtendSpeckleObjectByKeyValue(SpeckleObject=esokv_8, Keys="Length", Values=graft(pshift_6), selectedKitName="Objects")
pshift_8 = ShiftPaths(Data=esokv_9, Offset=-1)
send_5 = Send(
    Stream=sget_2,
    Data=pshift_8,
    A=esokv_7,
    AutoSend=False,
    BaseId="57a32993bd5b101e4bb355c39841258f",
    CurrentComponentState="expired",
    KitName="Objects",
    OutputWrappers="https://app.speckle.systems\t8902afff2a\t81daeb536b",
    UseDefaultCache=True,
    selectedKitName="Objects")
dso = DeconstructSpeckleObject(SpeckleObject=receive.Concrete, selectedKitName="None")  # -> _0, Units
panel_14 = Panel(sort.Keys)
dso_2 = DeconstructSpeckleObject(SpeckleObject=dso._0, selectedKitName="None")  # -> Area, Bbox, Colors, Faces, Name, Prices, TextureCoordinates, TextureCoordinatesCount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
to_native = ToNative(Base=dso._0, selectedKitName="Objects")  # -> graft(Data)
button = Button()
delonlay = DeleteOnLayer(Run=button, Layer="Concrete:@{0}", enableFullPath=False)
python_3 = GhPythonScript(x=dso_2.Prices)  # -> out, a, b
# ---------- python_3: Python ----------
__author__ = "Xavier"
__version__ = "2024.04.21"

import rhinoscriptsyntax as rs

a= x.Keys
b= x.Values
# ---------- end python_3 ----------
ef_att = EleFrontAttributes(Keys=python_3.a, Values=python_3.b, Name=dso_2.Name, Layer="Concrete:@{0}")  # -> Attributes, Keys, Values, Name, Layer, ColourSource, DisplayColour, MaterialSource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
dam_2 = DataDam(DataA=button, BufferDelay=10000000, BufferMode=2)
gsg = GetSelectedGeometry()  # -> Geometry
# ---------- gsg: Python ----------
"""
Get Selected Rhino Geometry. Dynamically recomputes on changes in Rhino document.
    Inputs:
    Outputs:
        Geometry: Selected Rhino geometry {list,geometry}
    Remarks:
        Author: Anders Holden Deleuran 
        Rhino: 7.12.21299.13001
        Version: 230929
"""

ghenv.Component.Name = "GetSelectedGeometry"
ghenv.Component.NickName = "GSG"

import Rhino as rc
import System.Drawing as sd
import GhPython.Assemblies.ExecutingComponent as component
from sets import Set

class MyMouseCallback(rc.UI.MouseCallback):
    
    def __init__(self):
        self.move = None
        
    def OnMouseMove(self,arg):
        self.move = arg
        
class GetRhinoGeometry(component):
    
    runs = 0
    Geometry = []
    info = []
    valueset=Set()
    keyset=Set()
    colorset= dict()
    sel = True
    def RunScript(self):
        self.runs += 1
        self.Message = "Recomputes: " + str(self.runs)
        self.Geometry = []
        self.info = []
        self.colorset=dict()
        valueset=Set()
        keyset=Set()
        for obj in rc.RhinoDoc.ActiveDoc.Objects.GetSelectedObjects(True,False):
            self.info.append(obj.Attributes.GetUserStrings())
            self.Geometry.append(obj.Geometry)
        for obj in rc.RhinoDoc.ActiveDoc.Objects:
            values = []
            for key in obj.Attributes.GetUserStrings().AllKeys:
                values.append(obj.Attributes.GetUserString(key))
            self.keyset = self.keyset | Set(obj.Attributes.GetUserStrings().AllKeys)
            self.valueset = self.valueset | Set(values)
        i=0
        length = len(self.keyset)
        for key in self.keyset:
            self.colorset[key]=sd.Color.FromArgb(255,255,255/length *i, 255-255/length *i )
            i+=1
        return self.Geometry
        
    def callBack(self,e):
        self.ExpireSolution(False)
        
    def get_ClippingBox(self):
        return rc.RhinoDoc.ActiveDoc.Views.ActiveView.ActiveViewport.GetFrustumBoundingBox()
        
    def updateComponent(self,sender,e):
        self.OnPingDocument().ScheduleSolution(1,self.callBack)
        
    def DrawForeground(self,sender,arg):
#        rc.RhinoApp.WriteLine(str(gh.Instances.ActiveCanvas.Document))
#        rc.RhinoApp.WriteLine(str(arg.RhinoDoc))
#        rc.RhinoApp.WriteLine(str(arg))
#        if (not ghenv.Component.Hidden and not ghenv.Component.Locked): 
#            and ghenv.Component.OnPingDocument() == gh.Instances.ActiveCanvas.Document
#            and arg.Viewport.Id == arg.RhinoDoc.ActiveDoc.Views.ActiveView.ActiveViewportID):
#        rc.RhinoApp.WriteLine("ok2")
            # Define rectangle to draw and get mouse position in viewport screen space
        
#            mpt = rc.Geometry.Point2d(self.mouse.move.ViewportPoint.X,self.mouse.move.ViewportPoint.Y)
#            worldpt = arg.RhinoDoc.ActiveDoc.Views.ActiveView.ActiveViewport.ClientToWorld(self.mouse.move.ViewportPoint)#arg.RhinoDoc.ActiveDoc.Views.ActiveView.ScreenToClient(mpt))
#            rc.RhinoApp.WriteLine(str(worldpt.From))
            #  if mouse is inside rectangle and draw different stuff dependingly
            
        
#        rc.RhinoApp.WriteLine(str(self.sel))
        check =self.info.Count
#        rc.RhinoApp.WriteLine(str(self.colorset))
        if (check>0):
            length =self.info[0].AllKeys.Count
            for i in range(length):
                key = self.info[0].AllKeys[i]
#            rc.RhinoApp.WriteLine(key)
                rec = sd.Rectangle(50,100+i*70,70,70)
                recPt = rc.Geometry.Point2d(rec.X + rec.Width+20,rec.Y+25)
                arg.Display.Draw2dRectangle(rec,sd.Color.Black,5,self.colorset[key])
#            arg.Display.Draw2dRectangle(rec,sd.Color.Black,10,sd.Color.DodgerBlue)
#            arg.Display.Draw2dText(self.txt,self.c2,mpt,False,25,"Consolas")
                arg.Display.Draw2dText(key+" : "+self.info[0][key],sd.Color.Black,recPt,False,30,"Avenir")
        else:
#            rc.RhinoApp.WriteLine(str(len(self.keyset)))
            length= len(self.keyset)
            i=0
            for key in self.keyset:
#                rc.RhinoApp.WriteLine(str(i))
                
                rec = sd.Rectangle(50,100+i*70,70,70)
                recPt = rc.Geometry.Point2d(rec.X + rec.Width+20,rec.Y+25)
                arg.Display.Draw2dRectangle(rec,sd.Color.Black,5,self.colorset[key])
#            arg.Display.Draw2dRectangle(rec,sd.Color.Black,10,sd.Color.DodgerBlue)
#            arg.Display.Draw2dText(self.txt,self.c2,mpt,False,25,"Consolas")
                arg.Display.Draw2dText(key,sd.Color.Black,recPt,False,30,"Avenir")
                i+=1
    def __enter__(self):
        rc.Display.DisplayPipeline.DrawForeground += self.DrawForeground
        rc.RhinoDoc.SelectObjects += self.updateComponent
        rc.RhinoDoc.DeselectObjects += self.updateComponent
        rc.RhinoDoc.DeselectAllObjects += self.updateComponent
        self.mouse = MyMouseCallback()
        self.mouse.Enabled = True
        
    def __exit__(self):
        rc.Display.DisplayPipeline.DrawForeground -= self.DrawForeground
        rc.RhinoDoc.SelectObjects -= self.updateComponent
        rc.RhinoDoc.DeselectObjects -= self.updateComponent
        rc.RhinoDoc.DeselectAllObjects -= self.updateComponent
#        self.mouse = MyMouseCallback()
        self.mouse.Enabled = False
        del self.mouse
# ---------- end gsg ----------
bake = BakeObjects(Geometry=to_native, Attributes=ef_att.Attributes, Bake=dam_2, createGroups=False, preset="Moderate")  # -> Message, Ghosts
panel_15 = Panel(to_native)
panel_16 = Panel(python_3.b)
